# Dynamo graph Read_text_and_Planar_Quads.dyn

file_path = StringFilename("C:\dev\Generative-drop-ceiling\Media\Test_Point_list.txt")
read_text_file = FileReader(file_path)
watch = Watch(read_text_file)
file_path_2 = StringFilename("C:\dev\Generative-drop-ceiling\Python\Read_txtfile_for_pointlist.py")
read_text_file_2 = FileReader(file_path_2)
python_script_from_string = PythonString(read_text_file_2, read_text_file)
draw = ForceDrawNode(python_script_from_string, lacing=Longest)
watch_3d = Watch3D(draw)
file_path_3 = StringFilename("C:\dev\Generative-drop-ceiling\Media\dummymodel2.sat")
import_sat = ImportSATNode(file_path_3, lacing=Longest)
string = StringInput("mitered_edges.sat")
planar_quads = StringFilename("C:\dev\Generative-drop-ceiling\Python\Planar_quads_Intersect_geometry.py")
read_text_file_3 = FileReader(planar_quads)
watch_2 = Watch(python_script_from_string)
python_script_from_string_2 = PythonString(read_text_file_3, watch_2)
watch_3 = Watch(python_script_from_string_2)
draw_2 = ForceDrawNode(watch_3, lacing=Longest)
watch_3d_2 = Watch3D(draw_2)
export_to_sat = ExportSATNode(string, watch_3d_2, lacing=Longest)
