# Dynamo graph ceiling_subdivision.dyn

file_path = StringFilename("C:\dev\Generative-drop-ceiling\Python\subdivide_nurbs_without_reference_surface.py")
read_text_file = FileReader(file_path)
file_path_2 = StringFilename("C:\dev\Generative-drop-ceiling\Media\testgeo_surfaces")
import_sat = ImportSATNode(file_path_2, lacing=Longest)
watch = Watch(import_sat)
watch_3d = Watch3D(watch)
python_script = Python(watch_3d)
# ---------- python_script.python (7 lines) ----------
#The input to this node will be stored in the IN variable.
dataEnteringNode = IN

input_surfaces = []
input_surfaces.extend(IN)
#Assign your output to the OUT variable
OUT = input_surfaces
# ----------------------------------------
watch_2 = Watch(python_script)
python_script_from_string = PythonString(read_text_file, watch_2)
watch_3 = Watch(python_script_from_string)
draw = ForceDrawNode(python_script_from_string, lacing=Longest)
watch_3d_2 = Watch3D(draw)
file_path_3 = StringFilename("C:\dev\Generative-drop-ceiling\Media\testgeo_srf")
import_sat_2 = ImportSATNode(file_path_3, lacing=Longest)
watch_4 = Watch(import_sat_2)
watch_3d_3 = Watch3D(import_sat_2)
python_script_2 = Python(watch_3d_3)
# ---------- python_script_2.python (16 lines) ----------
import sys
path = 'C:\\dev\\Dynamo\\bin\\Release'
sys.path.append(path)
import clr
clr.AddReference('LibGNet')
from Autodesk.LibG import *

from Autodesk.LibG import Point,Line,Surface,Polygon,Geometry

#The input to this node will be stored in the IN variable.
dataEnteringNode = IN

srf = IN[0]

#Assign your output to the OUT variable
OUT = srf
# ----------------------------------------
watch_5 = Watch(python_script_2)
list = NewList(index0=watch_5)
python_script_3 = Python(import_sat)
# ---------- python_script_3.python (35 lines) ----------
import sys
path = 'C:\\dev\\Dynamo\\bin\\Release'
sys.path.append(path)
import clr
clr.AddReference('LibGNet')
from Autodesk.LibG import *

from Autodesk.LibG import Point,Line,Surface,Polygon,Geometry

#The input to this node will be stored in the IN variable.
dataEnteringNode = IN

def corner_points(surf):
	
	ptlist = [0, 0, 0, 0]
	ptlist[0] = surf.point_at_parameter(0.0, 0.0)
	ptlist[1] = surf.point_at_parameter(1.0, 0.0)
	ptlist[2] = surf.point_at_parameter(1.0, 1.0)
	ptlist[3] = surf.point_at_parameter(0.0, 1.0)
	"""
	polyvert = surf.vertices()
	
	ptlist = []
	for i in range(polyvert.Count):
		ptlist.append(polyvert[i])
	"""	
	return ptlist
	
pts = []

for surfaces in IN:
	pts.extend(corner_points(surfaces))

#Assign your output to the OUT variable
OUT = pts
# ----------------------------------------
draw_2 = ForceDrawNode(python_script_3, lacing=Longest)
watch_6 = Watch(draw_2)
watch_3d_4 = Watch3D(watch_6)
