# Dynamo graph get_geometry_from_element_test.dyn

file_path = StringFilename("C:\dev\Generative-drop-ceiling\Python\get_geometry_transaction_test_2.py")
read_text_file = FileReader(file_path)
file_path_2 = StringFilename("C:\dev\Generative-drop-ceiling\Python\get_geometry_transaction_test.py")
read_text_file_2 = FileReader(file_path_2)
select_model_element = ModelElementSelection()  # 1 picked in the model
python_script_from_string = PythonString(read_text_file_2, select_model_element)
python_script_from_string_2 = PythonString(read_text_file, python_script_from_string)
watch = Watch(python_script_from_string_2)
watch_2 = Watch(python_script_from_string)
