# Dynamo graph get_revit_geo_test.dyn

draw = ForceDrawNode(lacing=Longest)
watch_3d = Watch3D(draw)
select_elements = MultipleCurvesBySelection()  # 777 picked in the model
python_script = Python(select_elements)
# ---------- python_script.python (39 lines) ----------
#The input to this node will be stored in the IN variable.
dataEnteringNode = IN
test = []
objects = IN

air_vents = []
column = []
light_fixtures = []
standard_geometry = []

def get_solid( revit_object ):
	elem = revit_object
	 
	trans = DynTransaction()
	trans.Start()
	 
	opt = Options()
	geometry_list = elem.get_Geometry(opt)
	
	trans.Commit()
	
	return geometry_list

for obj in objects:
	name = obj.Category.Name
	if "Air Terminals" in name:
		air_vents.append( name )
	elif "Column" in name:
		column.append(name)
	elif "Light" and "Fix" in name:
		light_fixtures.append(name)
	else:
		standard_geometry.append(name)
	#GetOriginalGeometry(Options())
	#.get_Geometry(Options())


#Assign your output to the OUT variable
OUT = air_vents, column, light_fixtures, standard_geometry
# ----------------------------------------
watch = Watch(python_script)
