# Dynamo graph make_planar.dyn

file_path = StringFilename("C:\dev\Generative-drop-ceiling\Python\make_planar.py")
read_text_file = FileReader(file_path)
watch = Watch(read_text_file)
number = DoubleInput(0)
file_path_2 = StringFilename("C:\dev\Generative-drop-ceiling\Media\dummymodel2.sat")
import_sat = ImportSATNode(file_path_2, lacing=Longest)
python_script_from_string = PythonString(read_text_file, import_sat)
get_from_list = GetFromList(number, python_script_from_string, lacing=Longest)
draw = ForceDrawNode(get_from_list, lacing=Longest)
watch_2 = Watch(python_script_from_string)
number_2 = DoubleInput(1)
get_from_list_2 = GetFromList(number_2, python_script_from_string, lacing=Longest)
draw_2 = ForceDrawNode(get_from_list_2, lacing=Longest)
