# Dynamo graph single_panel_articulation.dyn

file_path = StringFilename("C:\dev\Generative-drop-ceiling\Media\mitered_edges.sat")
import_sat = ImportSATNode(file_path, lacing=Longest)
watch = Watch(import_sat)
first_of_list = First(watch)
number = DoubleInput(2)
get_from_list = GetFromList(number, watch, lacing=Longest)
number_slider = DoubleSliderInput(5.75862069, range=0..7)
number_slider_2 = DoubleSliderInput(1.284163474, range=0..7)
get_from_list_2 = GetFromList(number_slider_2, watch, lacing=Longest)
watch_2 = Watch(get_from_list_2)
python_script = Python(watch_2)
# ---------- python_script.python (21 lines) ----------
import sys
path = 'C:\\dev\\Dynamo\\bin\\Release'
sys.path.append(path)
import clr
clr.AddReference('LibGNet')
from Autodesk.LibG import *

from Autodesk.LibG import Point,Line,Surface,Polygon,Geometry,Vector,Solid

#The input to this node will be stored in the IN variable.
dataEnteringNode = IN
obj = IN

surfaces = obj.surfaces ()

point = []
for  surface in surfaces:
	GraphicItem.persist(surface)

#Assign your output to the OUT variable
OUT = surfaces
# ----------------------------------------
watch_3 = Watch(python_script)
get_from_list_3 = GetFromList(number_slider, watch_3, lacing=Longest)
list = NewList(index0=get_from_list_3)
draw = ForceDrawNode(list, lacing=Longest)
watch_3d = Watch3D(draw)
watch_4 = Watch(get_from_list_3)
python_script_2 = Python(watch_4)
# ---------- python_script_2.python (16 lines) ----------
import sys
path = 'C:\\dev\\Dynamo\\bin\\Release'
sys.path.append(path)
import clr
clr.AddReference('LibGNet')
from Autodesk.LibG import *

from Autodesk.LibG import Point,Line,Surface,Polygon,Geometry,Vector,Solid

#The input to this node will be stored in the IN variable.
dataEnteringNode = IN
obj = IN

point = obj.point_at_parameter(0.5,0.5)

OUT = point
# ----------------------------------------
watch_5 = Watch(python_script_2)
list_2 = NewList(index0=python_script_2)
draw_2 = ForceDrawNode(list_2, lacing=Longest)
watch_3d_2 = Watch3D(draw_2)
python_script_3 = Python(watch_2)
# ---------- python_script_3.python (50 lines) ----------
import sys
path = 'C:\\dev\\Dynamo\\bin\\Release'
sys.path.append(path)
import clr
clr.AddReference('LibGNet')
from Autodesk.LibG import *

from Autodesk.LibG import Point,Line,Surface,Polygon,Geometry,Vector,Solid

#The input to this node will be stored in the IN variable.
dataEnteringNode = IN

solid = IN

solid_surfaces = solid.get_faces ()

surf_centroids = solid_surfaces[2].get_centroid()

srf_area_list = []
for surface in solid_surfaces:
	srf_area_list.append( [surface, surface.get_area()] )

sorted_surfaces = sorted(srf_area_list, key = lambda x: x[1], reverse = True)

clean_list = []
for i in range(2):
	clean_list.append([ sorted_surfaces[i][0] , sorted_surfaces[i][0].get_centroid().z() ])
	
final_sort_list = sorted(clean_list, key = lambda x: x[1], reverse = True)

vertices = final_sort_list[0][0].get_vertices ()
top_surface = final_sort_list[0][0].get_surface_geometry()
bottom_surface = final_sort_list[1][0].get_surface_geometry()

"""
#offset_surfaces
top_surface = top_surface.offset(3.0)
bottom_surface = bottom_surface.offset(3.0)
"""
test_Cent = final_sort_list[0][0].get_centroid()
sphere = Sphere.by_center_radius (test_Cent, 20.0)

face_points = []
for v in vertices:
	face_points.append(v.get_point_geometry() )
	
test = solid.subtract_from(sphere, True, True, True)

#Assign your output to the OUT variable
OUT = test
# ----------------------------------------
watch_6 = Watch(python_script_3)
list_3 = NewList(index0=python_script_3)
draw_3 = ForceDrawNode(list_3, lacing=Longest)
watch_3d_3 = Watch3D(draw_3)
python_script_4 = Python()
# ---------- python_script_4.python (11 lines) ----------
import System
from System import *

rand = Random()
OUT = (rand.Next() % 1000000) / 1000000.0

#The input to this node will be stored in the IN variable.
dataEnteringNode = IN

#Assign your output to the OUT variable
OUT = 0
# ----------------------------------------
